# Dynamo custom node APC_Mini.dyf (Dynamo 1.3.1.1736)
# category: Midi
# Custom node for the APC mini midi controller

code_block = CodeBlock { 55; }
myControl = Dynamidi.Dynamidi.myControl(code_block)
int = Output(myControl)
code_block_2 = CodeBlock { 54; }
myControl_2 = Dynamidi.Dynamidi.myControl(code_block_2)
int_2 = Output(myControl_2)  # "int"
code_block_3 = CodeBlock { 53; }
myControl_3 = Dynamidi.Dynamidi.myControl(code_block_3)
int_3 = Output(myControl_3)  # "int"
code_block_4 = CodeBlock { 52; }
myControl_4 = Dynamidi.Dynamidi.myControl(code_block_4)
int_4 = Output(myControl_4)  # "int"
code_block_5 = CodeBlock { 51; }
myControl_5 = Dynamidi.Dynamidi.myControl(code_block_5)
int_5 = Output(myControl_5)  # "int"
code_block_6 = CodeBlock { 50; }
myControl_6 = Dynamidi.Dynamidi.myControl(code_block_6)
int_6 = Output(myControl_6)  # "int"
code_block_7 = CodeBlock { 49; }
myControl_7 = Dynamidi.Dynamidi.myControl(code_block_7)
int_7 = Output(myControl_7)  # "int"
code_block_8 = CodeBlock { 48; }
myControl_8 = Dynamidi.Dynamidi.myControl(code_block_8)
int_8 = Output(myControl_8)  # "int"
