# Dynamo graph Demo.dyn (Dynamo 1.3.1.1736)

code_block = CodeBlock { 2; }
code_block_2 = CodeBlock { 3; }
code_block_3 = CodeBlock { 4; }
code_block_4 = CodeBlock { 9; }
create = List.Create(code_block, code_block_2, code_block_3, code_block_4)
noteOut = Dynamidi.Dynamidi.NoteOut(create)
watch = Watch(noteOut)
cc_channelOut = Dynamidi.Dynamidi.cc_channelOut()
watch_2 = Watch(cc_channelOut)
code_block_5 = CodeBlock { 1; }
cc_valueOut = Dynamidi.Dynamidi.cc_valueOut(code_block_5)
watch_3 = Watch(cc_valueOut)
code_block_6 = CodeBlock { 5; }
cc_controlOut = Dynamidi.Dynamidi.cc_controlOut(code_block_6)
watch_4 = Watch(cc_controlOut)
code_block_7 = CodeBlock { 0; }
controllerSetup = Dynamidi.Dynamidi.controllerSetup(code_block_7)
watch_5 = Watch(controllerSetup)
channelOut = Dynamidi.Dynamidi.channelOut()
watch_6 = Watch(channelOut)
