# Dynamo graph cylinder control.dyn (Dynamo 1.3.2.2480)

getDevice = Dynamidi.Dynamidi.getDevice()
deviceOpen = Dynamidi.Dynamidi.deviceOpen(getDevice)
deviceStart = Dynamidi.Dynamidi.deviceStart(deviceOpen)
isReceiving = Dynamidi.Dynamidi.isReceiving(deviceStart)
integer_slider = IntegerSlider(48, range=0..100 step 1)
cc_valueOut = Dynamidi.Dynamidi.cc_valueOut()
cc_controlOut = Dynamidi.Dynamidi.cc_controlOut()
myControl = Dynamidi.Dynamidi.myControl(integer_slider, cc_valueOut, cc_controlOut)
watch = Watch(myControl)
integer_slider_2 = IntegerSlider(49, range=0..100 step 1)
myControl_2 = Dynamidi.Dynamidi.myControl(integer_slider_2, cc_valueOut, cc_controlOut)
watch_2 = Watch(myControl_2)
cc_channelOut = Dynamidi.Dynamidi.cc_channelOut()
cc_controlOut_2 = Dynamidi.Dynamidi.cc_controlOut()
cc_valueOut_2 = Dynamidi.Dynamidi.cc_valueOut()
apcMiniSliders = Dynamidi.Dynamidi.apcMiniSliders(cc_controlOut_2, cc_valueOut_2)
byRadiusHeight = Cylinder.ByRadiusHeight(arg1=apcMiniSliders.out0, arg2=apcMiniSliders.out1)
number = DoubleInput(127)
div = apcMiniSliders.out2 / number
number_2 = DoubleInput(255)
mul = div * number_2
div_2 = apcMiniSliders.out3 / number
mul_2 = div_2 * number_2
div_3 = apcMiniSliders.out4 / number
mul_3 = div_3 * number_2
div_4 = apcMiniSliders.out5 / number
mul_4 = div_4 * number_2
byARGB = Color.ByARGB(a=mul, r=mul_2, g=mul_3, b=mul_4)
byGeometryColor = Display.Display.ByGeometryColor(byRadiusHeight, byARGB)
explode = Geometry.Explode(byRadiusHeight)
number_3 = DoubleInput(0)
getItemAtIndex = List.GetItemAtIndex(list=explode, index=number_3)
div_5 = apcMiniSliders.out6 / number
number_4 = DoubleInput(20)
mul_5 = div_5 * number_4
ceiling = Math.Ceiling(mul_5)
div_6 = apcMiniSliders.out7 / number
mul_6 = div_6 * number_4
ceiling_2 = Math.Ceiling(mul_6)
panelTriangleA = Geometry.Panel.PanelTriangleA(getItemAtIndex, ceiling, ceiling_2)
div_7 = apcMiniSliders.out8 / number
round = Math.Round(div_7)
sub = number_2 - mul_2
count = Count(panelTriangleA)
code_block = CodeBlock(x=mul, y=sub, z=count) { x..y..#z; }
sub_2 = number_2 - mul_3
code_block_2 = CodeBlock(x=mul_2, y=sub_2, z=count) { x..y..#z; }
sub_3 = number_2 - mul_4
code_block_3 = CodeBlock(x=mul_3, y=sub_3, z=count) { x..y..#z; }
byARGB_2 = Color.ByARGB(a=mul, r=code_block, g=code_block_2, b=code_block_3)
number_5 = DoubleInput(0)
number_6 = DoubleInput(1)
sub_4 = count - number_6
range = Range(start=number_5, end=sub_4, step=number_6, lacing=Longest)
remapRange = Math.RemapRange(numbers=range, newMin=number_5, newMax=number_6)
color_range = ColorRange(byARGB_2, remapRange, remapRange)
reverse = List.Reverse(color_range)
if_ = If(test=round, true=reverse, false=color_range)
byGeometryColor_2 = Display.Display.ByGeometryColor(panelTriangleA, if_)
create = List.Create(byARGB, byARGB_2)
